# Dynamo graph Andaime Mecanflex.dyn "Rafael" (Dynamo 2.18.1.5096)

boolean = BoolSelector(false)
janela_andaimes = Python(IN[0]=boolean)  # CPython3
# ---------- janela_andaimes.python (274 lines) ----------
import clr
clr.AddReference("System.Windows.Forms")
clr.AddReference("System.Drawing")
import System
from System.Windows.Forms import *
from System.Drawing import *

####### FROM NOW ON THE CODE #######

run = IN[0]

class CreateWindow(Form):
    def __init__(self):
        
        #Configurações gerais
        self.Text = "Andaimes"
        self.BackColor = Color.FromArgb(255, 255, 255)
        self.WindowState = FormWindowState.Normal
        self.CenterToScreen()
        self.BringToFront()
        self.Topmost = True
        self.largura = []
        self.comprimento = []
        
        #Tamanho da janela
        screenSize = Screen.GetWorkingArea(self)
        self.Width = screenSize.Width / 4
        self.Height = screenSize.Height / 3
        uiWidth = self.DisplayRectangle.Width
        uiHeight = self.DisplayRectangle.Height
        self.FormBorderStyle = FormBorderStyle.FixedDialog
        self.MaximizeBox = False
        
        #Label texto
        font = Font("Helvetica", 10)
        spacing = 10
  
        message = "Largura"
        userMessage = Label()
        userMessage.Font = font
        userMessage.AutoSize = True
        userMessage.Text = message
        userMessage.Location = Point(spacing, spacing)
        self.Controls.Add(userMessage)
        
        message = "Comprimento"
        userMessage = Label()
        userMessage.Font = font
        userMessage.AutoSize = True
        userMessage.Text = message
        userMessage.Location = Point(spacing, Button().Height * 3 + Label().Height + spacing * 4)
        self.Controls.Add(userMessage)
        
        message = "(0)"
        self.somaL = Label()
        self.somaL.Font = font
        self.somaL.Size = Size(uiWidth / 2 - spacing, uiHeight / 7)
        self.somaL.Text = message
        self.somaL.Location = Point(Button().Width * 3 + spacing * 2, Label().Height + spacing)
        self.Controls.Add(self.somaL)
        
        message = "(0)"
        self.somaC = Label()
        self.somaC.Font = font
        self.somaC.Size = Size(uiWidth / 2 - spacing, uiHeight / 7)
        self.somaC.Text = message
        self.somaC.Location = Point(Button().Width * 3 + spacing * 2, Button().Height * 3 + Label().Height * 2 + spacing * 4)
        self.Controls.Add(self.somaC)
        
        message = "Total: 0 x 0"
        self.total = Label()
        self.total.Font = font
        self.total.AutoSize = True
        self.total.Text = message
        self.total.Location = Point(spacing, Button().Height * 6 + Label().Height * 2 + spacing * 7)
        self.Controls.Add(self.total)
        
        #Botão travessa 70
        btn70 = Button()
        btn70.Text = "70"
        btn70.Location = Point(spacing, Label().Height + spacing)
        btn70.Click += self.ButtonClicked70L
        self.Controls.Add(btn70)
        
        btn70 = Button()
        btn70.Text = "70"
        btn70.Location = Point(spacing, Button().Height * 3 + Label().Height * 2 + spacing * 4)
        btn70.Click += self.ButtonClicked70C
        self.Controls.Add(btn70)
        
        #Botão travessa 100
        btn100 = Button()
        btn100.Text = "100"
        btn100.Location = Point(spacing, Button().Height + Label().Height + spacing)
        btn100.Click += self.ButtonClicked100L
        self.Controls.Add(btn100)
        
        btn100 = Button()
        btn100.Text = "100"
        btn100.Location = Point(spacing, Button().Height * 4 + Label().Height * 2 + spacing * 4)
        btn100.Click += self.ButtonClicked100C
        self.Controls.Add(btn100)
        
        #Botão travessa 150
        btn150 = Button()
        btn150.Text = "150"
        btn150.Location = Point(Button().Width + spacing, Label().Height + spacing)
        btn150.Click += self.ButtonClicked150L
        self.Controls.Add(btn150)
        
        btn150 = Button()
        btn150.Text = "150"
        btn150.Location = Point(Button().Width + spacing, Button().Height * 3 + Label().Height * 2 + spacing * 4)
        btn150.Click += self.ButtonClicked150C
        self.Controls.Add(btn150)
        
        #Botão travessa 200
        btn200 = Button()
        btn200.Text = "200"
        btn200.Location = Point(Button().Width + spacing, Button().Height + Label().Height + spacing)
        btn200.Click += self.ButtonClicked200L
        self.Controls.Add(btn200)
        
        btn200 = Button()
        btn200.Text = "200"
        btn200.Location = Point(Button().Width + spacing, Button().Height * 4 + Label().Height * 2 + spacing * 4)
        btn200.Click += self.ButtonClicked200C
        self.Controls.Add(btn200)
        
        #Botão travessa 250
        btn250 = Button()
        btn250.Text = "250"
        btn250.Location = Point(Button().Width * 2 + spacing, Label().Height + spacing)
        btn250.Click += self.ButtonClicked250L
        self.Controls.Add(btn250)
        
        btn250 = Button()
        btn250.Text = "250"
        btn250.Location = Point(Button().Width * 2 + spacing, Button().Height * 3 + Label().Height * 2 + spacing * 4)
        btn250.Click += self.ButtonClicked250C
        self.Controls.Add(btn250)
        
        #Botão travessa 300
        btn300 = Button()
        btn300.Text = "300"
        btn300.Location = Point(Button().Width * 2 + spacing, Button().Height + Label().Height + spacing)
        btn300.Click += self.ButtonClicked300L
        self.Controls.Add(btn300)
        
        btn300 = Button()
        btn300.Text = "300"
        btn300.Location = Point(Button().Width * 2 + spacing, Button().Height * 4 + Label().Height * 2 + spacing * 4)
        btn300.Click += self.ButtonClicked300C
        self.Controls.Add(btn300)
        
        #Botão remover
        btnRemover = Button()
        btnRemover.Text = "Remover"
        btnRemover.Location = Point(spacing, Button().Height * 2 + Label().Height + spacing * 1.5)
        btnRemover.Click += self.ButtonClickedRemoverL
        self.Controls.Add(btnRemover)
        
        btnRemover = Button()
        btnRemover.Text = "Remover"
        btnRemover.Location = Point(spacing, Button().Height * 5 + Label().Height * 2 + spacing * 4.5)
        btnRemover.Click += self.ButtonClickedRemoverC
        self.Controls.Add(btnRemover)

        #Botão zerar
        btnZerar = Button()
        btnZerar.Text = "Zerar"
        btnZerar.Location = Point(Button().Width * 2 + spacing, Button().Height * 6 + Label().Height * 2 + spacing * 7)
        btnZerar.Click += self.ButtonClickedZerar
        self.Controls.Add(btnZerar)

        #Botão ok
        btnOk = Button()
        btnOk.Text = "Ok"
        btnOk.Location = Point(uiWidth - (btnOk.Width + spacing), uiHeight - (btnOk.Height + spacing))
        btnOk.Anchor = (AnchorStyles.Bottom | AnchorStyles.Right)
        btnOk.Click += self.ButtonClickedOk
        self.Controls.Add(btnOk)
    
    def AtualizaSoma(self):
        self.somaL.Text = "({})".format(("+".join([str(e) for e in self.largura])))
        self.somaC.Text = "({})".format(("+".join([str(e) for e in self.comprimento])))
        self.total.Text = "Total: {} x {}".format(sum(self.largura), sum(self.comprimento))

    def ButtonClicked70L(self, sender, args):
        if sender.Click:
            self.largura.append(70)
            self.AtualizaSoma()
    
    def ButtonClicked70C(self, sender, args):
        if sender.Click:
            self.comprimento.append(70)
            self.AtualizaSoma()
    
    def ButtonClicked100L(self, sender, args):
        if sender.Click:
            self.largura.append(100)
            self.AtualizaSoma()
    
    def ButtonClicked100C(self, sender, args):
        if sender.Click:
            self.comprimento.append(100)
            self.AtualizaSoma()
    
    def ButtonClicked150L(self, sender, args):
        if sender.Click:
            self.largura.append(150)
            self.AtualizaSoma()
    
    def ButtonClicked150C(self, sender, args):
        if sender.Click:
            self.comprimento.append(150)
            self.AtualizaSoma()
    
    def ButtonClicked200L(self, sender, args):
        if sender.Click:
            self.largura.append(200)
            self.AtualizaSoma()
    
    def ButtonClicked200C(self, sender, args):
        if sender.Click:
            self.comprimento.append(200)
            self.AtualizaSoma()
    
    def ButtonClicked250L(self, sender, args):
        if sender.Click:
            self.largura.append(250)
            self.AtualizaSoma()
    
    def ButtonClicked250C(self, sender, args):
        if sender.Click:
            self.comprimento.append(250)
            self.AtualizaSoma()
    
    def ButtonClicked300L(self, sender, args):
        if sender.Click:
            self.largura.append(300)
            self.AtualizaSoma()
    
    def ButtonClicked300C(self, sender, args):
        if sender.Click:
            self.comprimento.append(300)
            self.AtualizaSoma()
    
    def ButtonClickedRemoverL(self, sender, args):
        if sender.Click:
            try: self.largura.pop()
            except IndexError: None
            self.AtualizaSoma()
    
    def ButtonClickedRemoverC(self, sender, args):
        if sender.Click:
            try: self.comprimento.pop()
            except IndexError: None
            self.AtualizaSoma()
    
    def ButtonClickedZerar(self, sender, args):
        if sender.Click:
            self.largura = []
            self.comprimento = []
            self.AtualizaSoma()
            
    def ButtonClickedOk(self, sender, args):
        if sender.Click:
            self.Close()

if run:
    form = CreateWindow()
    Application.Run(form)
    OUT = form.largura, form.comprimento
# ----------------------------------------
código_principal = Python(IN[0]=janela_andaimes)  # IronPython2
# ---------- código_principal.python (402 lines) ----------
import clr

sys.path.append(r'C:\Program Files (86x)\IronPython 2.7\Lib')
import System
from System.Collections.Generic import List

clr.AddReference('RevitAPI')
import Autodesk
from Autodesk.Revit.DB import IFailuresPreprocessor, FailureSeverity, FailureProcessingResult
from Autodesk.Revit.DB import ElementId, FamilyInstance, Transaction, Structure, AssemblyInstance, ElementTransformUtils
from Autodesk.Revit.DB import Document, SpecTypeId, UnitUtils
from Autodesk.Revit.DB import XYZ

clr.AddReference('RevitNodes')
import Revit
clr.ImportExtensions(Revit.GeometryConversion)

clr.AddReference('ProtoGeometry')
from Autodesk.DesignScript.Geometry import Point

clr.AddReference('RevitServices')
import RevitServices
from RevitServices.Persistence import DocumentManager

doc = DocumentManager.Instance.CurrentDBDocument
docUnitType = Document.GetUnits(doc).GetFormatOptions(SpecTypeId.Length).GetUnitTypeId()

####### FROM NOW ON THE CODE #######

class WarningFailureMessageClass(IFailuresPreprocessor):
    def PreprocessFailures(self, failuresAccessor):
        failureMessagesList = failuresAccessor.GetFailureMessages().GetEnumerator()
        for failure in failureMessagesList:
            if failure.GetSeverity() == FailureSeverity.Warning:
                failuresAccessor.DeleteWarning(failure)
        return FailureProcessingResult.Continue

def WarningFailureMessage(transaction):
    options = transaction.GetFailureHandlingOptions()
    options.SetFailuresPreprocessor(WarningFailureMessageClass())
    transaction.SetFailureHandlingOptions(options)

class Node:
    def __init__(self, value):
        self.left = None
        self.right = None
        self.value = value

class Grid:
    def __init__(self, width, length, height):
        self.elements = List[FamilyInstance]( )
        self.root = Node(Point.ByCoordinates(0, 0, height))
        self.Add(self.root, width, length)

    def Add(self, node, width, length):
        if length:
            if node.value.Y == self.root.value.Y:
                node.left = Node(Point.ByCoordinates(node.value.X + length[0], node.value.Y, node.value.Z))
                self.Add(node.left, width, length[1:])
                node.right = Node(Point.ByCoordinates(node.value.X, node.value.Y + width[0], node.value.Z))  
                self.Add(node.right, width[1:], length)
            elif width:
                node.left = Node(Point.ByCoordinates(node.value.X + length[0], node.value.Y, node.value.Z))
                node.right = Node(Point.ByCoordinates(node.value.X, node.value.Y + width[0], node.value.Z))
                self.Add(node.right, width[1:], length)
            else:
                node.left = Node(Point.ByCoordinates(node.value.X + length[0], node.value.Y, node.value.Z))         
        elif width: 
            node.right = Node(Point.ByCoordinates(node.value.X, node.value.Y + width[0], node.value.Z))
            self.Add(node.right, width[1:], length)

    def AddSapata(self, node):
        transaction = Transaction(doc, 'Colocar sapata')
        transaction.Start()
        instance = doc.Create.NewFamilyInstance(node.ToXyz(), sapata, Structure.StructuralType.NonStructural)
        transaction.Commit()
        self.elements.Add(instance)

    def AddSapatas(self, node):
        if node.left:
            if node.value.Y == self.root.value.Y:
                self.AddSapatas(node.left)
                self.AddSapatas(node.right)
                self.AddSapata(node.value)
            elif node.right:
                self.AddSapatas(node.right)
                self.AddSapata(node.value)
            else:
                self.AddSapata(node.value)
        elif node.right:
            self.AddSapatas(node.right)
            self.AddSapata(node.value)
        else:
            self.AddSapata(node.value)

    def AddPoste(self, node, poste):
        transaction = Transaction(doc, 'Colocar poste')
        transaction.Start()
        instance = doc.Create.NewFamilyInstance(node.ToXyz(), poste, Structure.StructuralType.NonStructural)
        transaction.Commit()
        self.elements.Add(instance)

    def AddPostes(self, node):
        if node.left:
            if node.value.Y == self.root.value.Y:
                self.AddPostes(node.left)
                self.AddPostes(node.right)
                self.AddPoste(node.value, poste)
            elif node.right:
                self.AddPostes(node.right)
                self.AddPoste(node.value, poste) if height - gridHeight >= 200 or node.value.X == self.root.value.X else None
                self.AddPoste(node.value, postes.get(27)) if height - gridHeight == 25 and node.value.X != self.root.value.X else None            
            else:
                self.AddPoste(node.value, poste)
        elif node.right:
            self.AddPostes(node.right)
            self.AddPoste(node.value, poste)
        else:
            self.AddPoste(node.value, poste)

    def AddTravessa(self, node1, node2):
        transaction = Transaction(doc, 'Colocar travessa')
        travessa = travessas.get(node1.DistanceTo(node2))
        direction = node2.ToXyz().Subtract(node1.ToXyz()).Normalize()
        transaction.Start()
        instance = doc.Create.NewFamilyInstance(node1.ToXyz(), travessa, direction, None, Structure.StructuralType.NonStructural)
        transaction.Commit()
        self.elements.Add(instance)

    def AddTravessas(self, node):
        if node.left:
            if node.value.Y == self.root.value.Y:
                self.AddTravessas(node.left)
                self.AddTravessas(node.right)
                self.AddTravessa(node.value, node.right.value) if gridHeight < height or node.value.X == self.root.value.X else None
                self.AddTravessa(node.value, node.left.value)
            elif node.right:
                self.AddTravessas(node.right)
                self.AddTravessa(node.value, node.right.value) if gridHeight < height or node.value.X == self.root.value.X else None
                self.AddTravessa(node.value, node.left.value) if gridHeight < height else None
            else:
                self.AddTravessa(node.value, node.left.value)
        elif node.right:
            self.AddTravessas(node.right)
            self.AddTravessa(node.value, node.right.value)

    def AddDiagonal(self, node1, node2):
        transaction = Transaction(doc, 'Colocar diagonal')
        diagonal = diagonais.get(node1.DistanceTo(node2))
        direction = node2.ToXyz().Subtract(node1.ToXyz()).Normalize()
        transaction.Start()
        instance = doc.Create.NewFamilyInstance(node1.ToXyz(), diagonal, direction, None, Structure.StructuralType.NonStructural)
        transaction.Commit()
        self.elements.Add(instance)
        return False

    def AddDiagonais(self, node):
        global status
        if node.left:
            if node.value.Y == self.root.value.Y:
                self.AddDiagonais(node.left)
                status = self.AddDiagonal(node.value, node.left.value) if status else True
                self.AddDiagonais(node.right)
                status = self.AddDiagonal(node.value, node.right.value) if status else True
            elif node.right:
                status = self.AddDiagonal(node.value, node.left.value) if status else True
                self.AddDiagonais(node.right)
                status = self.AddDiagonal(node.value, node.right.value) if status else True
            else:
                status = self.AddDiagonal(node.value, node.left.value) if status else True
        elif node.right:
            self.AddDiagonais(node.right)
            status = self.AddDiagonal(node.value, node.right.value) if status else True

    def AddPlataforma(self, node1, node2, length):
        distance = node1.DistanceTo(node2)
        vector = node2.ToXyz().Subtract(node1.ToXyz()).Normalize()
        direction = XYZ(1, 0, 0) if vector.IsAlmostEqualTo(XYZ(0, 1, 0)) else XYZ(0, 1, 0)
        node1 = node1.ToXyz()
        while distance >= 30:
            transaction = Transaction(doc, 'Colocar plataforma')
            width = 20 if distance == 30 or distance == 50 else 30  
            plataforma = str(width) + 'x' + str(length)
            transaction.Start()
            instance = doc.Create.NewFamilyInstance(node1, plataformas.get(plataforma), direction, None, Structure.StructuralType.NonStructural)
            transaction.Commit()
            self.elements.Add(instance)
            displacement = vector.Multiply(UnitUtils.ConvertToInternalUnits(width, docUnitType))
            node1 = node1.Add(displacement)
            distance -= width
        grid.CreateAssembly()

    def AddPlataformas(self, node):
        if node.left:
            if node.value.Y == self.root.value.Y:
                self.AddPlataformas(node.left)
                self.AddPlataformas(node.right)
                if node.value.DistanceTo(node.right.value) <= node.value.DistanceTo(node.left.value):
                    length = int(node.value.DistanceTo(node.left.value))
                    self.AddPlataforma(node.value, node.right.value, length)
                else:
                    length = int(node.value.DistanceTo(node.right.value))
                    self.AddPlataforma(node.left.value, node.value, length)
            elif node.right:
                self.AddPlataformas(node.right)
                if node.value.DistanceTo(node.right.value) <= node.value.DistanceTo(node.left.value):
                    length = int(node.value.DistanceTo(node.left.value))
                    self.AddPlataforma(node.value, node.right.value, length)
                else:
                    length = int(node.value.DistanceTo(node.right.value))
                    self.AddPlataforma(node.left.value, node.value, length)

    def AddRodape(self, node1, node2):
        transaction = Transaction(doc, 'Colocar rodape')
        rodape = rodapes.get(node1.DistanceTo(node2))
        direction = node2.ToXyz().Subtract(node1.ToXyz()).Normalize()
        transaction.Start()
        instance = doc.Create.NewFamilyInstance(node1.ToXyz(), rodape, direction, None, Structure.StructuralType.NonStructural)
        transaction.Commit()
        self.elements.Add(instance)

    def AddRodapes(self, node):
        if node.left:
            if node.value.Y == self.root.value.Y:
                self.AddRodapes(node.left)
                self.AddRodapes(node.right)
                self.AddRodape(node.value, node.right.value) if node.value.X == self.root.value.X else None
                self.AddRodape(node.value, node.left.value)
            elif node.right:
                self.AddRodapes(node.right)
                self.AddRodape(node.value, node.right.value) if node.value.X == self.root.value.X else None
            else:
                self.AddRodape(node.value, node.left.value)
        elif node.right:
            self.AddRodapes(node.right)
            self.AddRodape(node.value, node.right.value)

    def CreateAssembly(self):
        transaction = Transaction(doc, 'Criar montagem')
        category = self.elements[0].Category
        identifiers = List[ElementId](e.Id for e in self.elements)
        transaction.Start()
        instance = AssemblyInstance.Create(doc, identifiers, category.Id)
        transaction.Commit()
        self.elements = List[FamilyInstance]( )
        return instance

width = IN[0][0]
length = IN[0][1]
height = 850

grid = poste = instance = transaction = status = None
gridHeight = copyHeight = 0

sapata = doc.GetElement(ElementId(5485437))

postes = {27: doc.GetElement(ElementId(5398275)),
          150: doc.GetElement(ElementId(5390514)),
          200: doc.GetElement(ElementId(5393190)),
          300: doc.GetElement(ElementId(5396352))}

travessas = {70: doc.GetElement(ElementId(5599967)),
             100: doc.GetElement(ElementId(5946370)),
             150: doc.GetElement(ElementId(6095714)),
             200: doc.GetElement(ElementId(6315189)),
             250: doc.GetElement(ElementId(6505546)),
             300: doc.GetElement(ElementId(6526771))}

diagonais = {70: doc.GetElement(ElementId(5210994)),
             100: doc.GetElement(ElementId(5223995)),
             150: doc.GetElement(ElementId(5249997)),
             200: doc.GetElement(ElementId(5262992)),
             250: doc.GetElement(ElementId(5275996)),
             300: doc.GetElement(ElementId(5289000))}

plataformas = {'20x70': doc.GetElement(ElementId(5296673)),
               '20x100': doc.GetElement(ElementId(5302702)),
               '20x150': doc.GetElement(ElementId(5308764)),
               '20x200': doc.GetElement(ElementId(5314861)),
               '20x250': doc.GetElement(ElementId(5320995)),
               '20x300': doc.GetElement(ElementId(5327166)),
               '30x70': doc.GetElement(ElementId(5332143)),
               '30x100': doc.GetElement(ElementId(5337146)),
               '30x150': doc.GetElement(ElementId(5342184)),
               '30x200': doc.GetElement(ElementId(5347261)),
               '30x250': doc.GetElement(ElementId(5352374)),
               '30x300': doc.GetElement(ElementId(5357528))}

rodapes = {70: doc.GetElement(ElementId(5415497)),
           100: doc.GetElement(ElementId(5416572)),
           150: doc.GetElement(ElementId(5417647)),
           200: doc.GetElement(ElementId(5420871)),
           250: doc.GetElement(ElementId(5421946)),
           300: doc.GetElement(ElementId(5423027))}

#Colocar sapatas
grid = Grid(width, length, 0)
grid.AddSapatas(grid.root)
grid.CreateAssembly()

#Colocar postes
grid = Grid(width, length, 25)
poste = postes.get(200) if height%200 <= 50 else postes.get(300)
grid.AddPostes(grid.root)
grid.CreateAssembly()

gridHeight = 225 if poste == postes.get(200) else 325
i = int((height + 25 - gridHeight) / 200)
if i:
    grid = Grid(width, length, gridHeight)
    poste = postes.get(200)
    grid.AddPostes(grid.root)
    instance = grid.CreateAssembly()
    copyHeight = 200
    i -= 1
    while i > 0:
        transaction = Transaction(doc, 'Copiar montagem de postes para cima')
        WarningFailureMessage(transaction)
        transaction.Start()
        ElementTransformUtils.CopyElement(doc, instance.Id, Point.ByCoordinates(0, 0, copyHeight).ToXyz())
        transaction.Commit()
        copyHeight += 200
        i -= 1

gridHeight += copyHeight
grid = Grid(width, length, gridHeight)
poste = postes.get(150) if gridHeight > height else postes.get(200)
grid.AddPostes(grid.root)
grid.CreateAssembly()

#Colocar travessas
gridHeight = max(height%200, 50)
grid = Grid(width, length, gridHeight)
grid.AddTravessas(grid.root)
instance = grid.CreateAssembly()

copyHeight = 150 if height%200 == 0 else 200
i = round((height - gridHeight) / 200.0)
while i > 0:
    transaction = Transaction(doc, 'Copiar montagem de travessas para cima')
    WarningFailureMessage(transaction)
    transaction.Start()
    ElementTransformUtils.CopyElement(doc, instance.Id, Point.ByCoordinates(0, 0, copyHeight).ToXyz())
    transaction.Commit()
    copyHeight += 200
    i -= 1

gridHeight = height + 50
grid = Grid(width, length, gridHeight)
grid.AddTravessas(grid.root)
instance = grid.CreateAssembly()

transaction = Transaction(doc, 'Guarda corpo')
WarningFailureMessage(transaction)
transaction.Start()
ElementTransformUtils.CopyElement(doc, instance.Id, Point.ByCoordinates(0, 0, 50).ToXyz())
ElementTransformUtils.CopyElement(doc, instance.Id, Point.ByCoordinates(0, 0, 100).ToXyz())
transaction.Commit()

#Colocar diagonais
if height >= 250:
    status = True
    gridHeight = max(height%200, 50)
    grid = Grid(width, length, gridHeight)
    grid.AddDiagonais(grid.root)
    instance = grid.CreateAssembly()
    
    gridHeight += 150 if height%200 == 0 else 200
    copyHeight = 350 if height%200 == 0 else 400
    i = int((height - gridHeight) / 400)
    while i > 0:
        transaction = Transaction(doc, 'Copiar montagem de diagonais para cima')
        WarningFailureMessage(transaction)
        transaction.Start()
        ElementTransformUtils.CopyElement(doc, instance.Id, Point.ByCoordinates(0, 0, copyHeight).ToXyz())
        transaction.Commit()
        copyHeight += 400
        i -= 1
        
    if height - gridHeight >= 200:
        status = False
        grid = Grid(width, length, gridHeight)
        grid.AddDiagonais(grid.root)
        instance = grid.CreateAssembly()
        
        gridHeight += 200
        copyHeight = 400
        i = int((height - gridHeight) / 400)
        while i > 0:
            transaction = Transaction(doc, 'Copiar montagem de diagonais para cima')
            WarningFailureMessage(transaction)
            transaction.Start()
            ElementTransformUtils.CopyElement(doc, instance.Id, Point.ByCoordinates(0, 0, copyHeight).ToXyz())
            transaction.Commit()
            copyHeight += 400
            i -= 1

#Colocar plataformas e rodapés
grid = Grid(width, length, height)
grid.AddPlataformas(grid.root)
grid.AddRodapes(grid.root)
grid.CreateAssembly()
# ----------------------------------------
lista_de_familias = Python()  # CPython3; unwired: IN[0]
# ---------- lista_de_familias.python (10 lines) ----------
import clr

from RevitServices.Persistence import DocumentManager
from Autodesk.Revit.DB import *

doc = DocumentManager.Instance.CurrentDBDocument

####### FROM NOW ON THE CODE #######

OUT = FilteredElementCollector(doc).OfClass(FamilySymbol).ToElements()
# ----------------------------------------
